# Dynamo graph script.dyn (Dynamo 2.12.1.8246)
# packages: Crumple 2022.5.27, Genius Loci 2021.11.10, Data-Shapes 2022.2.106

# group: select line
code_block = CodeBlock { "Select Line"; }
code_block_2 = CodeBlock { true; }
selectmodelelements_data = Custom[SelectModelElements Data](ButtonText=code_block, SelectSingleElement=code_block_2)  # package Data-Shapes; Creates a Revit element selection input for UI.MultipleInputForm++ . Check out www.data-shapes.net for more infos!

# group: select family
code_block_3 = CodeBlock { "Select Family"; }
family_types = Python()  # IronPython2; unwired: IN[0]
# ---------- family_types.python (18 lines) ----------
import clr

clr.AddReference("RevitServices")
import RevitServices
from RevitServices.Persistence import DocumentManager
doc = DocumentManager.Instance.CurrentDBDocument

clr.AddReference("RevitAPI")
from Autodesk.Revit.DB import *

clr.AddReference("RevitNodes")
import Revit
clr.ImportExtensions(Revit.Elements)


types = FilteredElementCollector(doc).OfClass(FamilySymbol)

OUT = [el.ToDSType(True) for el in types]
# ----------------------------------------
name = Element.Name(element=family_types)
code_block_4 = CodeBlock { 100; }
boolean = BoolSelector(false)
listview_data = Custom[Listview Data](InputName=code_block_3, Keys=name, Values=family_types, Height_optionnal=code_block_4, ShowId_optionnal=boolean)  # package Data-Shapes; Create data for ListView input in UI.MultiInputForm ++ . Check out www.data-shapes.net for more infos.

code_block_5 = CodeBlock { "0"; }

# group: distribution distance
code_block_6 = CodeBlock { "Segment distance"; }
code_block_7 = CodeBlock { true; }
textbox_data = Custom[TextBox Data](InputName=code_block_6, DefaultText=code_block_5, IsNumberEntry=code_block_7)  # package Data-Shapes; Create Data for TextBox input in UI.MultipleInputForm ++ . Check out www.data-shapes.net for more informations

# group: rotation
code_block_8 = CodeBlock { "Select object rotation"; }
code_block_9 = CodeBlock { [00, 90, 180, 270]; }
code_block_10 = CodeBlock { 0; }
radiobuttons_data = Custom[RadioButtons Data](InputName=code_block_8, Keys=code_block_9, Values=code_block_9, DefaultValueIndex=code_block_10)  # package Data-Shapes; Create radio buttons input for UI.MultipleInputForm ++ .

# group: positive or negative origin
code_block_11 = CodeBlock { "Positive or Negative offset?"; }
code_block_12 = CodeBlock { ["Positive", "Negative"]; }
code_block_13 = CodeBlock { [true, false]; }
code_block_14 = CodeBlock { 0; }
radiobuttons_data_2 = Custom[RadioButtons Data](InputName=code_block_11, Keys=code_block_12, Values=code_block_13, DefaultValueIndex=code_block_14)

# group: origin offset
code_block_15 = CodeBlock { "Offset (if applicable)"; }
code_block_16 = CodeBlock { "0"; }
code_block_17 = CodeBlock { true; }
textbox_data_2 = Custom[TextBox Data](InputName=code_block_15, DefaultText=code_block_16, IsNumberEntry=code_block_17)

list_create = List.Create(item0=selectmodelelements_data, item1=listview_data, item2=textbox_data, item3=radiobuttons_data, item4=radiobuttons_data_2, item5=textbox_data_2)

# group: main UI
code_block_18 = CodeBlock { "Create Family Instance by Line"; }
file_path = Filename("..\..\Downloads\pngwing.com.png")
code_block_19 = CodeBlock { "Execute"; }
boolean_2 = BoolSelector(true)
code_block_20 = CodeBlock { "Mission Abort"; }
multipleinputform = Custom[MultipleInputForm ++](Description_optional=code_block_18, Logo_optional=file_path, ButtonText_optional=code_block_19, Inputs=list_create, Toggle=boolean_2, CancelButtonText_optional=code_block_20)  # package Data-Shapes; Create a form with multiple inputs. see www.data-shapes.net for tutorials and infos!

element = CodeBlock(x=multipleinputform.User_Inputs) { x[0]; }
curve = CurveElement.Curve(curveElement=element)
startPoint = Curve.StartPoint(curve=curve)

# group: divide line
segment = CodeBlock(x=multipleinputform.User_Inputs) { x[2]; }
integer = Python(IN[0]=segment)  # IronPython2
# ---------- integer.python (3 lines) ----------
val = IN[0]

OUT = int(val)
# ----------------------------------------
pointsAtSegmentLengthFromPoint = Curve.PointsAtSegmentLengthFromPoint(curve=curve, point=startPoint, segmentLength=integer)

endPoint = Curve.EndPoint(curve=curve)

# group: vector
byTwoPoints = Vector.ByTwoPoints(start=startPoint, end=endPoint)
x_postive_or_negative = CodeBlock(x=multipleinputform.User_Inputs) { x[4]; }
code_block_21 = CodeBlock(x=multipleinputform.User_Inputs) { x[5]; }
integer_2 = Python(IN[0]=code_block_21)  # IronPython2; same code as integer
posi_or_nega = Python(IN[0]=x_postive_or_negative, IN[1]=integer_2)  # IronPython2
# ---------- posi_or_nega.python (7 lines) ----------
bool_val = IN[0]
int_val = IN[1]

if bool_val:
	OUT = int_val * 1
else:
	OUT = int_val * -1
# ----------------------------------------
translate = Geometry.Translate(geometry=pointsAtSegmentLengthFromPoint, direction=byTwoPoints, distance=posi_or_nega)

# group: create family instance
family_type = CodeBlock(x=multipleinputform.User_Inputs) { x[1]; }
byPoint = FamilyInstance.ByPoint(familyType=family_type, point=translate, lacing=Longest)

# group: family rotation
rotation = CodeBlock(x=multipleinputform.User_Inputs) { x[3]; }
element_setrotation = Custom[Element SetRotation](element=byPoint, degree=rotation)  # package Genius Loci; Set the angle of the element around its local Z-axis. (Same as the Rotate command in Revit)

# group: delete line
flow_waitfor = Custom[© Flow.WaitFor](data=element, waitFor=element_setrotation)  # package Crumple; Tells the first input to wait for the second input to arrive, then passes on the first input. Really useful for scripts which have branching paths that rely on their outputs to carry each other forward. Quite a few custom packages have a 'passthrough' or 'waitfor' node. I use these all the time, so find it useful to have them contained in this package also.
delete = Element.Delete(element=flow_waitfor)
