# Dynamo graph script.dyn (Dynamo 2.12.1.8246)
# packages: Data-Shapes 2022.2.106, Crumple 2022.5.27, Genius Loci 2021.11.10, Clockwork for Dynamo 2.x 2.6.0, archi-lab.net 2022.212.2722

file_path = Filename("..\..\..\..\..\..\Downloads\pngwing.com.png")

# group: select curve
code_block = CodeBlock { "Detail Line"; "Select curve"; }
boolean = BoolSelector(true)
selectmodelelements_data = Custom[SelectModelElements Data](InputName=code_block.out0, ButtonText=code_block.out1, SelectSingleElement=boolean)  # package Data-Shapes; Creates a Revit element selection input for UI.MultipleInputForm++ . Check out www.data-shapes.net for more infos!

# group: select level
code_block_2 = CodeBlock { "Select Level"; }
categories = Categories("OST_Levels")
all_elements_of_category = ElementsOfCategory(Category=categories)
name = Element.Name(element=all_elements_of_category)
code_block_3 = CodeBlock { 75; }
boolean_2 = BoolSelector(false)
listview_data = Custom[Listview Data](InputName=code_block_2, Keys=name, Values=all_elements_of_category, Height_optionnal=code_block_3, ShowId_optionnal=boolean_2)  # package Data-Shapes; Create data for ListView input in UI.MultiInputForm ++ . Check out www.data-shapes.net for more infos.

# group: select wall type
code_block_4 = CodeBlock { "Select wall type"; }
element_types = ElementTypes("Wall")
all_elements_of_type = ElementsOfType(element_type=element_types)
elementType = Element.ElementType(element=all_elements_of_type)
name_2 = Element.Name(element=elementType)
code_block_5 = CodeBlock { 75; }
boolean_3 = BoolSelector(false)
listview_data_2 = Custom[Listview Data](InputName=code_block_4, Keys=name_2, Values=elementType, Height_optionnal=code_block_5, ShowId_optionnal=boolean_3)

# group: select family
code_block_6 = CodeBlock { "Select Family"; }
categories_2 = Categories("OST_SpecialityEquipment")
all_family_types_of_category = Custom[All Family Types Of Category](category=categories_2)  # package Clockwork for Dynamo 2.x; Gets all family types/symbols of a given category in the model.
name_3 = Element.Name(element=all_family_types_of_category)
code_block_7 = CodeBlock { 100; }
boolean_4 = BoolSelector(false)
listview_data_3 = Custom[Listview Data](InputName=code_block_6, Keys=name_3, Values=all_family_types_of_category, Height_optionnal=code_block_7, ShowId_optionnal=boolean_4)

# group: select axis
code_block_8 = CodeBlock { "Select Axis"; }
boolean_5 = BoolSelector(true)
code_block_9 = CodeBlock { "ON = XAxis | OFF = YAxis"; }
boolean_input = Custom[Boolean input](InputName=code_block_8, DefaultValue=boolean_5, SideText=code_block_9)  # package Data-Shapes; Creates a boolean input for UI.MultipleInputForm ++ . Check out www.data-shapes.net for more infos!

code_block_10 = CodeBlock { [true, false]; }

# group: direction of object
code_block_11 = CodeBlock { ["0", "180", "90", "270"]; }
code_block_12 = CodeBlock { "Cabinet Position"; }
code_block_13 = CodeBlock { ["Left", "Right"]; }
code_block_14 = CodeBlock { [false, true]; }
dropdown_data = Custom[DropDown Data](InputName=code_block_12, Keys=code_block_13, Values=code_block_14)  # package Data-Shapes; Create data for DropDown input in UI.MultiInputForm ++ . Check out www.data-shapes.net for more infos.
dropdown_data_2 = Custom[DropDown Data](InputName=code_block_12, Keys=code_block_13, Values=code_block_10)
code_block_15 = CodeBlock { ["Top", "Bottom"]; }
code_block_16 = CodeBlock { false; }
dropdown_data_3 = Custom[DropDown Data](InputName=code_block_12, Keys=code_block_15, Values=code_block_10, Sorted_optional=code_block_16)
dropdown_data_4 = Custom[DropDown Data](InputName=code_block_12, Keys=code_block_15, Values=code_block_14, Sorted_optional=code_block_16)
list_create = List.Create(item0=dropdown_data, item1=dropdown_data_2, item2=dropdown_data_3, item3=dropdown_data_4)
conditionalinput_data = Custom[ConditionalInput Data](Options=code_block_11, InputGroups_by_Option=list_create)  # package Data-Shapes; Allows to create inputs that are enabled/disabled by a condition dor UI.MultipleInputForm++.

list_create_2 = List.Create(item0=selectmodelelements_data, item1=listview_data, item2=listview_data_2, item3=listview_data_3, item4=boolean_input, item5=conditionalinput_data)
code_block_17 = CodeBlock { 1000; }
code_block_18 = CodeBlock { 550; }

# group: Main UI
code_block_19 = CodeBlock { "CREATE RISER AND IT-CAB"; }
code_block_20 = CodeBlock { "Execute"; }
boolean_6 = BoolSelector(true)
code_block_21 = CodeBlock { "Mission Abort"; }
multipleinputform = Custom[MultipleInputForm ++](Description_optional=code_block_19, Logo_optional=file_path, ButtonText_optional=code_block_20, Inputs=list_create_2, Toggle=boolean_6, CancelButtonText_optional=code_block_21, MaxHeight_optional=code_block_17, Width_optional=code_block_18)  # package Data-Shapes; Create a form with multiple inputs. see www.data-shapes.net for tutorials and infos!

code_block_22 = CodeBlock(x=multipleinputform.User_Inputs) { x[0]; x[1]; x[2]; x[3]; }
curve = CurveElement.Curve(curveElement=code_block_22.out0)
code_block_23 = CodeBlock { 2800; }
byCurveAndHeight = Wall.ByCurveAndHeight(curve=curve, height=code_block_23, level=code_block_22.out1, wallType=code_block_22.out2)

# group: get direction of cabinet vector
code_block_24 = CodeBlock(x=multipleinputform.User_Inputs) { x[6]; x[7]; x[8]; x[9]; }
list_create_3 = List.Create(item0=code_block_24.out0, item1=code_block_24.out1, item2=code_block_24.out2, item3=code_block_24.out3)
flatten = List.Flatten(list=list_create_3)
clear_list = Custom[Clear List](input=flatten)  # package archi-lab.net; This node will remove all Null and Empty Lists from any list.
number = DoubleInput(1300)
code_block_25 = CodeBlock(x=number) { x*-1; }
if_ = RefactoredIf(test=clear_list, true=number, false=code_block_25)

offset = Curve.Offset(curve=curve, distance=if_)
xy_axis = CodeBlock(x=multipleinputform.User_Inputs) { x[4]; }
rotation = CodeBlock(x=multipleinputform.User_Inputs) { x[5]; }
convert_to_integer = Python(IN[0]=rotation)  # IronPython2
# ---------- convert_to_integer.python (3 lines) ----------
element = IN[0]

OUT = int(element)
# ----------------------------------------
start_point_and_direction = Python(IN[0]=convert_to_integer)  # "start point and direction condition T/F"; IronPython2
# ---------- start_point_and_direction.python (8 lines) ----------
rotation_val = IN[0]

if rotation_val == 90 or rotation_val == 180:
	OUT = True
elif rotation_val == 00 or rotation_val == 270:
	OUT = False
else:
	OUT = None
# ----------------------------------------

# group: create line
startPoint = Curve.StartPoint(curve=offset)
XAxis = Vector.XAxis()
YAxis = Vector.YAxis()
# note: -6000 = right to left/top to bottom
# 6000 = left to right/bottom to up
python_script = Python(IN[0]=xy_axis, IN[1]=XAxis, IN[2]=YAxis)  # IronPython2
# ---------- python_script.python (8 lines) ----------
bool_val = IN[0]
x_axis = IN[1]
y_axis = IN[2]

if bool_val:
	OUT = x_axis
else:
	OUT = y_axis
# ----------------------------------------
multiply_by_or = Python(IN[0]=start_point_and_direction)  # IronPython2
# ---------- multiply_by_or.python (7 lines) ----------
bool_val = IN[0]
num_val= 6000

if bool_val:
	OUT = num_val * -1
else:
	OUT = num_val 
# ----------------------------------------
byStartPointDirectionLength = Line.ByStartPointDirectionLength(startPoint=startPoint, direction=python_script, length=multiply_by_or)

startPoint_2 = Curve.StartPoint(curve=byStartPointDirectionLength)

# group: divide line
code_block_26 = CodeBlock { 800; }
pointsAtSegmentLengthFromPoint = Curve.PointsAtSegmentLengthFromPoint(curve=byStartPointDirectionLength, point=startPoint_2, segmentLength=code_block_26)

# group: move point
XAxis_2 = Vector.XAxis()
YAxis_2 = Vector.YAxis()
python_script_2 = Python(IN[0]=xy_axis, IN[1]=XAxis_2, IN[2]=YAxis_2)  # IronPython2; same code as python_script
# note: 400 = right to left
# -400 = left to right
code_block_27 = CodeBlock { 400; }
python_script_3 = Python(IN[0]=multiply_by_or, IN[1]=code_block_27)  # IronPython2
# ---------- python_script_3.python (7 lines) ----------
el_val = IN[0]
inp_val = IN[1]

if el_val < 0:
	OUT = inp_val * 1
else:
	OUT = inp_val * -1
# ----------------------------------------
translate = Geometry.Translate(geometry=pointsAtSegmentLengthFromPoint, direction=python_script_2, distance=python_script_3)

flatten_2 = List.Flatten(list=translate)
dropLastItem = Custom[List.DropLastItem](list=flatten_2)  # package Clockwork for Dynamo 2.x; Drops the last item from a given list.

# group: create family instance
byPoint = FamilyInstance.ByPoint(familyType=code_block_22.out3, point=dropLastItem, lacing=Longest)

# group: family rotation
# note: 90 deg right to left
# 270 deg left to right
element_setrotation = Custom[Element SetRotation](element=byPoint, degree=convert_to_integer)  # package Genius Loci; Set the angle of the element around its local Z-axis. (Same as the Rotate command in Revit)

# group: delete line
flow_waitfor = Custom[© Flow.WaitFor](data=code_block_22.out0, waitFor=element_setrotation)  # package Crumple; Tells the first input to wait for the second input to arrive, then passes on the first input. Really useful for scripts which have branching paths that rely on their outputs to carry each other forward. Quite a few custom packages have a 'passthrough' or 'waitfor' node. I use these all the time, so find it useful to have them contained in this package also.
delete = Element.Delete(element=flow_waitfor)
