# Dynamo graph script.dyn (Dynamo 2.12.1.8246)
# packages: Data-Shapes 2022.2.106, Crumple 2022.5.27

code_block = CodeBlock { "WALL BY LEVEL"; }
file_path = Filename("..\..\Downloads\pngwing.com.png")
code_block_2 = CodeBlock { "Execute"; }

# group: select curve
code_block_3 = CodeBlock { "Select line"; }
boolean = BoolSelector(false)
selectmodelelements_data = Custom[SelectModelElements Data](ButtonText=code_block_3, SelectSingleElement=boolean)  # package Data-Shapes; Creates a Revit element selection input for UI.MultipleInputForm++ . Check out www.data-shapes.net for more infos!

# group: start level
code_block_4 = CodeBlock { "From Level"; }
element_types = ElementTypes("Level")
all_elements_of_type = ElementsOfType(element_type=element_types)
name = Element.Name(element=all_elements_of_type)
dropdown_data = Custom[DropDown Data](InputName=code_block_4, Keys=name, Values=all_elements_of_type)  # package Data-Shapes; Create data for DropDown input in UI.MultiInputForm ++ . Check out www.data-shapes.net for more infos.

# group: top level
code_block_5 = CodeBlock { "To Level"; }
element_types_2 = ElementTypes("Level")
all_elements_of_type_2 = ElementsOfType(element_type=element_types_2)
name_2 = Element.Name(element=all_elements_of_type_2)
dropdown_data_2 = Custom[DropDown Data](InputName=code_block_5, Keys=name_2, Values=all_elements_of_type_2)

# group: wall type
code_block_6 = CodeBlock { "Select Wall Type"; }
element_types_3 = ElementTypes("Wall")
all_elements_of_type_3 = ElementsOfType(element_type=element_types_3)
elementType = Element.ElementType(element=all_elements_of_type_3)
name_3 = Element.Name(element=elementType)
dropdown_data_3 = Custom[DropDown Data](InputName=code_block_6, Keys=name_3, Values=elementType)

list_create = List.Create(item0=selectmodelelements_data, item1=dropdown_data, item2=dropdown_data_2, item3=dropdown_data_3)

# group: main UI
code_block_7 = CodeBlock { "CREATE WALL WITH LINE"; }
file_path_2 = Filename("..\..\Downloads\pngwing.com.png")
code_block_8 = CodeBlock { "Go"; }
code_block_9 = CodeBlock { ["By Level", "By Height"]; }
radiobuttons_data = Custom[RadioButtons Data](Keys=code_block_9, Values=code_block_9)  # package Data-Shapes; Create radio buttons input for UI.MultipleInputForm ++ .
boolean_2 = BoolSelector(true)
code_block_10 = CodeBlock { "No Go"; }
multipleinputform = Custom[MultipleInputForm ++](Description_optional=code_block_7, Logo_optional=file_path_2, ButtonText_optional=code_block_8, Inputs=radiobuttons_data, Toggle=boolean_2, CancelButtonText_optional=code_block_10)  # package Data-Shapes; Create a form with multiple inputs. see www.data-shapes.net for tutorials and infos!
code_block_11 = CodeBlock(x=multipleinputform.User_Inputs) { x[0]; }
python_script = Python(IN[0]=code_block_11)  # IronPython2
# ---------- python_script.python (6 lines) ----------
bool_val = IN[0]

if bool_val == "By Level":
	OUT = 1
else:
	OUT = 0
# ----------------------------------------

trigger_by_level = Python(IN[0]=python_script)  # IronPython2
# ---------- trigger_by_level.python (7 lines) ----------
in_int = IN[0]


if in_int == 1:
	OUT = True
else:
	OUT = False
# ----------------------------------------
code_block_12 = CodeBlock { "Mission Abort"; }
multipleinputform_2 = Custom[MultipleInputForm ++](Description_optional=code_block, Logo_optional=file_path, ButtonText_optional=code_block_2, Inputs=list_create, Toggle=trigger_by_level, CancelButtonText_optional=code_block_12)
code_block_13 = CodeBlock(x=multipleinputform_2.User_Inputs) { x[0]; }
curve = CurveElement.Curve(curveElement=code_block_13)
code_block_14 = CodeBlock(X=multipleinputform_2.User_Inputs) { X[1]; X[2]; X[3]; }
byCurveAndLevels = Wall.ByCurveAndLevels(curve=curve, startLevel=code_block_14.out0, endLevel=code_block_14.out1, wallType=code_block_14.out2)
flow_waitfor = Custom[© Flow.WaitFor](data=code_block_13, waitFor=byCurveAndLevels)  # package Crumple; Tells the first input to wait for the second input to arrive, then passes on the first input. Really useful for scripts which have branching paths that rely on their outputs to carry each other forward. Quite a few custom packages have a 'passthrough' or 'waitfor' node. I use these all the time, so find it useful to have them contained in this package also.
delete = Element.Delete(element=flow_waitfor)
code_block_15 = CodeBlock { "WALL BY HEIGHT"; }
file_path_3 = Filename("..\..\Downloads\pngwing.com.png")
code_block_16 = CodeBlock { "Execute"; }

# group: select curve
code_block_17 = CodeBlock { "Select line"; }
boolean_3 = BoolSelector(false)
selectmodelelements_data_2 = Custom[SelectModelElements Data](ButtonText=code_block_17, SelectSingleElement=boolean_3)

# group: start level
code_block_18 = CodeBlock { "From Level"; }
element_types_4 = ElementTypes("Level")
all_elements_of_type_4 = ElementsOfType(element_type=element_types_4)
name_4 = Element.Name(element=all_elements_of_type_4)
dropdown_data_4 = Custom[DropDown Data](InputName=code_block_18, Keys=name_4, Values=all_elements_of_type_4)

# group: specify height
code_block_19 = CodeBlock { "Wall Height"; }
code_block_20 = CodeBlock { true; }
textbox_data = Custom[TextBox Data](InputName=code_block_19, IsNumberEntry=code_block_20)  # package Data-Shapes; Create Data for TextBox input in UI.MultipleInputForm ++ . Check out www.data-shapes.net for more informations

# group: wall type
code_block_21 = CodeBlock { "Select Wall Type"; }
element_types_5 = ElementTypes("Wall")
all_elements_of_type_5 = ElementsOfType(element_type=element_types_5)
elementType_2 = Element.ElementType(element=all_elements_of_type_5)
name_5 = Element.Name(element=elementType_2)
dropdown_data_5 = Custom[DropDown Data](InputName=code_block_21, Keys=name_5, Values=elementType_2)

list_create_2 = List.Create(item0=selectmodelelements_data_2, item1=dropdown_data_4, item2=textbox_data, item3=dropdown_data_5)
trigger_by_height = Python(IN[0]=python_script)  # IronPython2
# ---------- trigger_by_height.python (7 lines) ----------
in_int = IN[0]


if in_int == 0:
	OUT = True
else:
	OUT = False
# ----------------------------------------
code_block_22 = CodeBlock { "Mission Abort"; }
multipleinputform_3 = Custom[MultipleInputForm ++](Description_optional=code_block_15, Logo_optional=file_path_3, ButtonText_optional=code_block_16, Inputs=list_create_2, Toggle=trigger_by_height, CancelButtonText_optional=code_block_22)
code_block_23 = CodeBlock(x=multipleinputform_3.User_Inputs) { x[0]; }
curve_2 = CurveElement.Curve(curveElement=code_block_23)
code_block_24 = CodeBlock(X=multipleinputform_3.User_Inputs) { X[1]; X[2]; X[3]; }
byCurveAndHeight = Wall.ByCurveAndHeight(curve=curve_2, height=code_block_24.out1, level=code_block_24.out0, wallType=code_block_24.out2)
flow_waitfor_2 = Custom[© Flow.WaitFor](data=code_block_23, waitFor=byCurveAndHeight)
delete_2 = Element.Delete(element=flow_waitfor_2)
