# Dynamo graph script.dyn (Dynamo 2.12.1.8246)
# packages: archi-lab.net 2022.212.2722, Data-Shapes 2022.2.106

categories = Categories("OST_Sheets")
all_elements_of_category = ElementsOfCategory(Category=categories)
code_block = CodeBlock { "Plot Batch"; }
getParameterValueByName = Element.GetParameterValueByName(element=all_elements_of_category, parameterName=code_block)

# group: param text
code_block_2 = CodeBlock { "Text in parameter"; }
textbox_data = Custom[TextBox Data](InputName=code_block_2)  # package Data-Shapes; Create Data for TextBox input in UI.MultipleInputForm ++ . Check out www.data-shapes.net for more informations

# group: view set name
code_block_3 = CodeBlock { "View set name"; }
textbox_data_2 = Custom[TextBox Data](InputName=code_block_3)

list_create = List.Create(item0=textbox_data, item1=textbox_data_2)

# group: main UI
code_block_4 = CodeBlock { "Create View Set to Print"; }
code_block_5 = CodeBlock { "Execute"; }
boolean = BoolSelector(true)
code_block_6 = CodeBlock { "Mission Abort"; }
multipleinputform = Custom[MultipleInputForm ++](Description_optional=code_block_4, ButtonText_optional=code_block_5, Inputs=list_create, Toggle=boolean, CancelButtonText_optional=code_block_6)  # package Data-Shapes; Create a form with multiple inputs. see www.data-shapes.net for tutorials and infos!
code_block_7 = CodeBlock(x=multipleinputform.User_Inputs) { x[0]; x[1]; }

eq = getParameterValueByName == code_block_7.out0
filterByBoolMask = List.FilterByBoolMask(list=all_elements_of_category, mask=eq)
byViewsName = archilab.Revit.Views.ViewSets.ByViewsName(views=filterByBoolMask.in, name=code_block_7.out1)
