# Dynamo graph script.dyn (Dynamo 2.12.1.8246)
# packages: Data-Shapes 2022.2.106

# group: text data
code_block = CodeBlock()
# ---------- code_block.designscript (2 lines) ----------
"Desired angle
[0, 45, 90, 135, 180, 225, 270, 315]";
# ----------------------------------------
textnote_data = Custom[TextNote Data](TextNote=code_block)  # package Data-Shapes; Create Data for TextNote input in UI.MultipleInputForm ++ . Check out www.data-shapes.net for more informations

# group: wall selection
code_block_2 = CodeBlock { "Select Wall(s)"; }
categories = Categories("OST_Walls")
boolean = BoolSelector(false)
selectmodelelements_data = Custom[SelectModelElements Data](ButtonText=code_block_2, CategoryFilter=categories, SelectSingleElement=boolean)  # package Data-Shapes; Creates a Revit element selection input for UI.MultipleInputForm++ . Check out www.data-shapes.net for more infos!

# group: main ui
code_block_3 = CodeBlock { "ROTATE WALL TO PROPER ORIENTATION"; "Execute"; "Cancel"; }
list_create = List.Create(item0=textnote_data, item1=selectmodelelements_data)
boolean_2 = BoolSelector(true)
code_block_4 = CodeBlock { 200; 80; }
multipleinputform = Custom[MultipleInputForm ++](Description_optional=code_block_3.out0, ButtonText_optional=code_block_3.out1, Inputs=list_create, Toggle=boolean_2, CancelButtonText_optional=code_block_3.out2, Width_optional=code_block_4.out0, LabelWidth_optional=code_block_4.out1)  # package Data-Shapes; Create a form with multiple inputs. see www.data-shapes.net for tutorials and infos!

code_block_5 = CodeBlock(x=multipleinputform.User_Inputs) { x[0]; }
getLocation = Element.GetLocation(element=code_block_5)
startPoint = Curve.StartPoint(curve=getLocation)
ZAxis = Vector.ZAxis()
XAxis = Vector.XAxis()

# group: get the angle
direction = Line.Direction(line=getLocation)
# note: desired angle
# [0, 45, 90, 135, 180, 225, 270, 315]
ZAxis_2 = Vector.ZAxis()
angleAboutAxis = Vector.AngleAboutAxis(vector=XAxis, otherVector=direction, rotationAxis=ZAxis_2)
previous_angle = Watch(angleAboutAxis)  # graph output

# group: python
rotate_to_nearest_45deg_py = Python(IN[0]=previous_angle)  # IronPython2
# ---------- rotate_to_nearest_45deg_py.python (44 lines) ----------
extracted_angle = IN[0]

# convert single float to list
if isinstance(extracted_angle, int):
    extracted_angle = [extracted_angle]

rounded_angles = []

# check if input is a list
if isinstance(extracted_angle, list):
    for angle in extracted_angle:
        if 350 <= angle <= 360:
            angle = 0
            rounded_angles.append(angle)
        elif 0 <= angle <= 10:
            angle = 0
            rounded_angles.append(angle)
        elif 35 <= angle <= 55:
            angle = 45
            rounded_angles.append(angle)
        elif 80 <= angle <= 100:
            angle = 90
            rounded_angles.append(angle)
        elif 125 <= angle <= 145:
            angle = 135
            rounded_angles.append(angle)
        elif 170 <= angle <= 190:
            angle = 180
            rounded_angles.append(angle)
        elif 215 <= angle <= 235:
            angle = 225
            rounded_angles.append(angle)
        elif 260 <= angle <= 280:
            angle = 270
            rounded_angles.append(angle)
        elif 305 <= angle <= 325:
            angle = 315
            rounded_angles.append(angle)
        else:
            rounded_angles.append(angle)

    OUT = rounded_angles
else:
    OUT = "Error: input must be a float or a list of floats"
# ----------------------------------------

code_block_6 = CodeBlock(x=rotate_to_nearest_45deg_py, y=previous_angle) { x-y; }

# group: rotate revit element
rotate = Geometry.Rotate(geometry=getLocation, origin=startPoint, axis=ZAxis, degrees=code_block_6)

# group: set rotated element back to model - transaction end
setLocation = Element.SetLocation(element=code_block_5, geometry=rotate)

# group: result
XAxis_2 = Vector.XAxis()
direction_2 = Line.Direction(line=rotate)
ZAxis_3 = Vector.ZAxis()
angleAboutAxis_2 = Vector.AngleAboutAxis(vector=XAxis_2, otherVector=direction_2, rotationAxis=ZAxis_3)
new_angle = Watch(angleAboutAxis_2)  # graph output
