# Dynamo graph script.dyn "RoomDoorDescription_RIL_1DoortType" (Dynamo 2.12.1.8246)
# packages: Rhythm 2022.11.4, Data-Shapes 2022.2.106

code_block = CodeBlock { "Select 1 Door and a Room"; }
file_path = Filename("..\..\Downloads\pngwing.com.png")
code_block_2 = CodeBlock { "Execute"; }

# group: room
code_block_3 = CodeBlock { "Select Room"; }
categories = Categories("OST_Rooms")
boolean = BoolSelector(true)
selectmodelelements_data = Custom[SelectModelElements Data](ButtonText=code_block_3, CategoryFilter=categories, SelectSingleElement=boolean)  # package Data-Shapes; Creates a Revit element selection input for UI.MultipleInputForm++ . Check out www.data-shapes.net for more infos!

# group: door
code_block_4 = CodeBlock { "Select Door"; }
categories_2 = Categories("OST_Doors")
boolean_2 = BoolSelector(true)
selectmodelelements_data_2 = Custom[SelectModelElements Data](ButtonText=code_block_4, CategoryFilter=categories_2, SelectSingleElement=boolean_2)

list_create = List.Create(item0=selectmodelelements_data, item1=selectmodelelements_data_2)
boolean_3 = BoolSelector(true)
code_block_5 = CodeBlock { "Mission Abort"; }
code_block_6 = CodeBlock { 200; 80; }
multipleinputform = Custom[MultipleInputForm ++](Description_optional=code_block, Logo_optional=file_path, ButtonText_optional=code_block_2, Inputs=list_create, Toggle=boolean_3, CancelButtonText_optional=code_block_5, Width_optional=code_block_6.out0, LabelWidth_optional=code_block_6.out1)  # package Data-Shapes; Create a form with multiple inputs. see www.data-shapes.net for tutorials and infos!
room = CodeBlock(x=multipleinputform.User_Inputs) { x[0]; }
code_block_7 = CodeBlock { ","; }
door = CodeBlock(x=multipleinputform.User_Inputs) { x[1]; }

# group: gather known parameters
code_block_8 = CodeBlock { "Door Operation"; }
ʳʰʸᵗʰᵐ_elements = Rhythm.Revit.Elements.Elements.GetParameterValueByNameTypeOrInstance(element=door, parameterName=code_block_8)
code_block_9 = CodeBlock { "Door Panel"; }
ʳʰʸᵗʰᵐ_elements_2 = Rhythm.Revit.Elements.Elements.GetParameterValueByNameTypeOrInstance(element=door, parameterName=code_block_9)
code_block_10 = CodeBlock { "Door Construction"; }
ʳʰʸᵗʰᵐ_elements_3 = Rhythm.Revit.Elements.Elements.GetParameterValueByNameTypeOrInstance(element=door, parameterName=code_block_10)
code_block_11 = CodeBlock { "Door Lock Function"; }
ʳʰʸᵗʰᵐ_elements_4 = Rhythm.Revit.Elements.Elements.GetParameterValueByNameTypeOrInstance(element=door, parameterName=code_block_11)

join = String.Join(separator=code_block_7, string0=ʳʰʸᵗʰᵐ_elements, string1=ʳʰʸᵗʰᵐ_elements_2, string2=ʳʰʸᵗʰᵐ_elements_3, string3=ʳʰʸᵗʰᵐ_elements_4)

# group: Door Feature Code - broken down
code_block_12 = CodeBlock { "Door Feature"; }
ʳʰʸᵗʰᵐ_elements_5 = Rhythm.Revit.Elements.Elements.GetParameterValueByNameTypeOrInstance(element=door, parameterName=code_block_12)
string = StringInput(",")
split = String.Split(string=ʳʰʸᵗʰᵐ_elements_5, separator0=string)

join_2 = String.Join(separator=code_block_7, string0=split)

# group: Concatenated string 1: if door feature doesn't exist it won't be added
concatenate_string = Python(IN[0]=join, IN[1]=join_2)  # IronPython2
# ---------- concatenate_string.python (15 lines) ----------
a = IN[0]
b = IN[1]

if b:
    if isinstance(a, str) and isinstance(b, list):
        c = a + ',' + ','.join(map(str, b))
    elif isinstance(a, list) and isinstance(b, str):
        c = ','.join(map(str, a)) + ',' + b
    elif isinstance(a, list) and isinstance(b, list):
        c = ','.join(map(str, a)) + ',' + ','.join(map(str, b))
    else:
        c = str(a) + ',' + str(b)
    OUT = c
else:
    OUT = a
# ----------------------------------------

# group: Set Parameter
code_block_13 = CodeBlock { "Room Door Description"; }
ʳʰʸᵗʰᵐ_elements_6 = Rhythm.Revit.Elements.Elements.SetParameterByNameTypeOrInstance(element=room, parameterName=code_block_13, value=concatenate_string)

# group: Check door number - do check the order of the elements - cross check with the given RIL sheet
code_block_14 = CodeBlock { "Door Number"; }
ʳʰʸᵗʰᵐ_elements_7 = Rhythm.Revit.Elements.Elements.GetParameterValueByNameTypeOrInstance(element=door, parameterName=code_block_14)
watch = Watch(ʳʰʸᵗʰᵐ_elements_7)
