# Dynamo graph script.dyn (Dynamo 2.12.1.8246)
# packages: Rhythm 2022.11.4, Data-Shapes 2022.2.106

code_block = CodeBlock { "Select 1 Door and a Room"; }
file_path = Filename("..\..\Downloads\pngwing.com.png")
code_block_2 = CodeBlock { "Execute"; }

# group: room
code_block_3 = CodeBlock { "Select Room"; }
categories = Categories("OST_Rooms")
boolean = BoolSelector(true)
selectmodelelements_data = Custom[SelectModelElements Data](ButtonText=code_block_3, CategoryFilter=categories, SelectSingleElement=boolean)  # package Data-Shapes; Creates a Revit element selection input for UI.MultipleInputForm++ . Check out www.data-shapes.net for more infos!

# group: door1
code_block_4 = CodeBlock { "Select Door 1"; }
categories_2 = Categories("OST_Doors")
boolean_2 = BoolSelector(true)
selectmodelelements_data_2 = Custom[SelectModelElements Data](ButtonText=code_block_4, CategoryFilter=categories_2, SelectSingleElement=boolean_2)

# group: door2
code_block_5 = CodeBlock { "Select Door 2"; }
categories_3 = Categories("OST_Doors")
boolean_3 = BoolSelector(true)
selectmodelelements_data_3 = Custom[SelectModelElements Data](ButtonText=code_block_5, CategoryFilter=categories_3, SelectSingleElement=boolean_3)

list_create = List.Create(item0=selectmodelelements_data, item1=selectmodelelements_data_2, item2=selectmodelelements_data_3)
boolean_4 = BoolSelector(true)
code_block_6 = CodeBlock { "Mission Abort"; }
code_block_7 = CodeBlock { 200; 80; }
multipleinputform = Custom[MultipleInputForm ++](Description_optional=code_block, Logo_optional=file_path, ButtonText_optional=code_block_2, Inputs=list_create, Toggle=boolean_4, CancelButtonText_optional=code_block_6, Width_optional=code_block_7.out0, LabelWidth_optional=code_block_7.out1)  # package Data-Shapes; Create a form with multiple inputs. see www.data-shapes.net for tutorials and infos!
room = CodeBlock(x=multipleinputform.User_Inputs) { x[0]; }
doors = CodeBlock(x=multipleinputform.User_Inputs) { x[1]; x[2]; }
list_create_2 = List.Create(item0=doors.out0, item1=doors.out1)

# group: gather known parameters
code_block_8 = CodeBlock { "Door Operation"; }
ʳʰʸᵗʰᵐ_elements = Rhythm.Revit.Elements.Elements.GetParameterValueByNameTypeOrInstance(element=list_create_2, parameterName=code_block_8)
code_block_9 = CodeBlock { "Door Panel"; }
ʳʰʸᵗʰᵐ_elements_2 = Rhythm.Revit.Elements.Elements.GetParameterValueByNameTypeOrInstance(element=list_create_2, parameterName=code_block_9)
code_block_10 = CodeBlock { "Door Construction"; }
ʳʰʸᵗʰᵐ_elements_3 = Rhythm.Revit.Elements.Elements.GetParameterValueByNameTypeOrInstance(element=list_create_2, parameterName=code_block_10)
code_block_11 = CodeBlock { "Door Lock Function"; }
ʳʰʸᵗʰᵐ_elements_4 = Rhythm.Revit.Elements.Elements.GetParameterValueByNameTypeOrInstance(element=list_create_2, parameterName=code_block_11)

# group: Split the list of information of 2 doors
code_block_12 = CodeBlock { ","; }
list_create_3 = List.Create(item0=ʳʰʸᵗʰᵐ_elements, item1=ʳʰʸᵗʰᵐ_elements_2, item2=ʳʰʸᵗʰᵐ_elements_3, item3=ʳʰʸᵗʰᵐ_elements_4)
code_block_13 = CodeBlock { 0; 1; }
getItemAtIndex = List.GetItemAtIndex(list=list_create_3@L2, index=code_block_13.out0)
join = String.Join(separator=code_block_12, string0=getItemAtIndex)
getItemAtIndex_2 = List.GetItemAtIndex(list=list_create_3@L2, index=code_block_13.out1)
join_2 = String.Join(separator=code_block_12, string0=getItemAtIndex_2)

# group: Door Feature Code - broken down
code_block_14 = CodeBlock { "Door Feature"; }
ʳʰʸᵗʰᵐ_elements_5 = Rhythm.Revit.Elements.Elements.GetParameterValueByNameTypeOrInstance(element=list_create_2, parameterName=code_block_14)
string = StringInput(",")
split = String.Split(string=ʳʰʸᵗʰᵐ_elements_5, separator0=string)

# group: Split the dictionary based on the 2 inputs
code_block_15 = CodeBlock { 0; 1; }
getItemAtIndex_3 = List.GetItemAtIndex(list=split, index=code_block_15.out0)
getItemAtIndex_4 = List.GetItemAtIndex(list=split, index=code_block_15.out1)

# group: Concatenated string 1: if door feature doesn't exist it won't be added
concatenate_string = Python(IN[0]=join, IN[1]=getItemAtIndex_3)  # IronPython2
# ---------- concatenate_string.python (8 lines) ----------
a = IN[0]
b = IN[1]

if b:
	c = a + b
	OUT = c
else:
	OUT = a
# ----------------------------------------
join_3 = String.Join(separator=code_block_12, string0=concatenate_string)

# group: Concatenated String 2
concatenate_string_2 = Python(IN[0]=join_2, IN[1]=getItemAtIndex_4)  # IronPython2; same code as concatenate_string
join_4 = String.Join(separator=code_block_12, string0=concatenate_string_2)

# group: Set Parameter
code_block_16 = CodeBlock { "Room Door Description"; }
code_block_17 = CodeBlock(a=join_3, b=join_4) { a+"\n"+b; }
ʳʰʸᵗʰᵐ_elements_6 = Rhythm.Revit.Elements.Elements.SetParameterByNameTypeOrInstance(element=room, parameterName=code_block_16, value=code_block_17)
