# Dynamo graph script.dyn "RoomDoorDescription_RIL_4DoorsType" (Dynamo 2.12.1.8246)
# packages: Rhythm 2022.11.4, Data-Shapes 2022.2.106

code_block = CodeBlock { "Select 1 Door and a Room"; }
file_path = Filename("..\..\Downloads\pngwing.com.png")
code_block_2 = CodeBlock { "Execute"; }

# group: room
code_block_3 = CodeBlock { "Select Room"; }
categories = Categories("OST_Rooms")
boolean = BoolSelector(true)
selectmodelelements_data = Custom[SelectModelElements Data](ButtonText=code_block_3, CategoryFilter=categories, SelectSingleElement=boolean)  # package Data-Shapes; Creates a Revit element selection input for UI.MultipleInputForm++ . Check out www.data-shapes.net for more infos!

# group: door1
code_block_4 = CodeBlock { "Select Door 1"; }
categories_2 = Categories("OST_Doors")
boolean_2 = BoolSelector(true)
selectmodelelements_data_2 = Custom[SelectModelElements Data](ButtonText=code_block_4, CategoryFilter=categories_2, SelectSingleElement=boolean_2)

# group: door2
code_block_5 = CodeBlock { "Select Door 2"; }
categories_3 = Categories("OST_Doors")
boolean_3 = BoolSelector(true)
selectmodelelements_data_3 = Custom[SelectModelElements Data](ButtonText=code_block_5, CategoryFilter=categories_3, SelectSingleElement=boolean_3)

# group: door3
code_block_6 = CodeBlock { "Select Door 3"; }
categories_4 = Categories("OST_Doors")
boolean_4 = BoolSelector(true)
selectmodelelements_data_4 = Custom[SelectModelElements Data](ButtonText=code_block_6, CategoryFilter=categories_4, SelectSingleElement=boolean_4)

# group: door4
code_block_7 = CodeBlock { "Select Door 4"; }
categories_5 = Categories("OST_Doors")
boolean_5 = BoolSelector(true)
selectmodelelements_data_5 = Custom[SelectModelElements Data](ButtonText=code_block_7, CategoryFilter=categories_5, SelectSingleElement=boolean_5)

list_create = List.Create(item0=selectmodelelements_data, item1=selectmodelelements_data_2, item2=selectmodelelements_data_3, item3=selectmodelelements_data_4, item4=selectmodelelements_data_5)
boolean_6 = BoolSelector(true)
code_block_8 = CodeBlock { "Mission Abort"; }
code_block_9 = CodeBlock { 200; 80; }
multipleinputform = Custom[MultipleInputForm ++](Description_optional=code_block, Logo_optional=file_path, ButtonText_optional=code_block_2, Inputs=list_create, Toggle=boolean_6, CancelButtonText_optional=code_block_8, Width_optional=code_block_9.out0, LabelWidth_optional=code_block_9.out1)  # package Data-Shapes; Create a form with multiple inputs. see www.data-shapes.net for tutorials and infos!
code_block_10 = CodeBlock(x=multipleinputform.User_Inputs) { x[0]; }
code_block_11 = CodeBlock(x=multipleinputform.User_Inputs) { x[1]; x[2]; x[3]; x[4]; }
list_create_2 = List.Create(item0=code_block_11.out0, item1=code_block_11.out1, item2=code_block_11.out2, item3=code_block_11.out3)

# group: gather known parameters
code_block_12 = CodeBlock { "Door Operation"; }
ʳʰʸᵗʰᵐ_elements = Rhythm.Revit.Elements.Elements.GetParameterValueByNameTypeOrInstance(element=list_create_2, parameterName=code_block_12)
code_block_13 = CodeBlock { "Door Panel"; }
ʳʰʸᵗʰᵐ_elements_2 = Rhythm.Revit.Elements.Elements.GetParameterValueByNameTypeOrInstance(element=list_create_2, parameterName=code_block_13)
code_block_14 = CodeBlock { "Door Construction"; }
ʳʰʸᵗʰᵐ_elements_3 = Rhythm.Revit.Elements.Elements.GetParameterValueByNameTypeOrInstance(element=list_create_2, parameterName=code_block_14)
code_block_15 = CodeBlock { "Door Lock Function"; }
ʳʰʸᵗʰᵐ_elements_4 = Rhythm.Revit.Elements.Elements.GetParameterValueByNameTypeOrInstance(element=list_create_2, parameterName=code_block_15)

# group: Split the list of information of 4 doors
code_block_16 = CodeBlock { ","; }
list_create_3 = List.Create(item0=ʳʰʸᵗʰᵐ_elements, item1=ʳʰʸᵗʰᵐ_elements_2, item2=ʳʰʸᵗʰᵐ_elements_3, item3=ʳʰʸᵗʰᵐ_elements_4)
code_block_17 = CodeBlock { 0; 1; 2; 3; }
getItemAtIndex = List.GetItemAtIndex(list=list_create_3@L2, index=code_block_17.out0)
join = String.Join(separator=code_block_16, string0=getItemAtIndex)
getItemAtIndex_2 = List.GetItemAtIndex(list=list_create_3@L2, index=code_block_17.out1)
join_2 = String.Join(separator=code_block_16, string0=getItemAtIndex_2)
getItemAtIndex_3 = List.GetItemAtIndex(list=list_create_3@L2, index=code_block_17.out2)
join_3 = String.Join(separator=code_block_16, string0=getItemAtIndex_3)
getItemAtIndex_4 = List.GetItemAtIndex(list=list_create_3@L2, index=code_block_17.out3)
join_4 = String.Join(separator=code_block_16, string0=getItemAtIndex_4)

# group: Door Feature Code - broken down
code_block_18 = CodeBlock { "Door Feature"; }
ʳʰʸᵗʰᵐ_elements_5 = Rhythm.Revit.Elements.Elements.GetParameterValueByNameTypeOrInstance(element=list_create_2, parameterName=code_block_18)
string = StringInput(",")
split = String.Split(string=ʳʰʸᵗʰᵐ_elements_5, separator0=string)

# group: Split the dictionary based on the 4 inputs
getItemAtIndex_5 = List.GetItemAtIndex(list=split, index=code_block_17.out0)
getItemAtIndex_6 = List.GetItemAtIndex(list=split, index=code_block_17.out1)
getItemAtIndex_7 = List.GetItemAtIndex(list=split, index=code_block_17.out2)
getItemAtIndex_8 = List.GetItemAtIndex(list=split, index=code_block_17.out3)

code_block_19 = CodeBlock(t1=getItemAtIndex_5) { str2 = String.Join(",", [t1]); }

# group: Concatenated string 1
code_block_20 = CodeBlock(a=join, b=code_block_19) { a+","+b; }

code_block_21 = CodeBlock(t1=getItemAtIndex_6) { str2 = String.Join(",", [t1]); }

# group: Concatenated String 2
code_block_22 = CodeBlock(a=join_2, b=code_block_21) { a+","+b; }

code_block_23 = CodeBlock(t1=getItemAtIndex_7) { str2 = String.Join(",", [t1]); }

# group: Concatenated String 3
code_block_24 = CodeBlock(a=join_3, b=code_block_23) { a+","+b; }

code_block_25 = CodeBlock(t1=getItemAtIndex_8) { str2 = String.Join(",", [t1]); }

# group: Concatenated String 4
code_block_26 = CodeBlock(a=join_4, b=code_block_25) { a+","+b; }

# group: Set parameter value
code_block_27 = CodeBlock { "Room Door Description"; }
code_block_28 = CodeBlock(a=code_block_20, b=code_block_22, c=code_block_24, d=code_block_26) { a+"\n"+b+"\n"+c+"\n"+d; }
ʳʰʸᵗʰᵐ_elements_6 = Rhythm.Revit.Elements.Elements.SetParameterByNameTypeOrInstance(element=code_block_10, parameterName=code_block_27, value=code_block_28)

# group: Check door number - do check the order of the elements - cross check with the given RIL sheet
code_block_29 = CodeBlock { "Door Number"; }
ʳʰʸᵗʰᵐ_elements_7 = Rhythm.Revit.Elements.Elements.GetParameterValueByNameTypeOrInstance(element=list_create_2, parameterName=code_block_29)
watch = Watch(ʳʰʸᵗʰᵐ_elements_7)
