# Dynamo graph script.dyn (Dynamo 2.12.1.8246)
# packages: Rhythm 2021.7.3, Crumple 2022.5.27, Data-Shapes 2022.2.106

code_block = CodeBlock { "Select Excel File"; }
code_block_2 = CodeBlock { "Execute"; }
choose_excel_file = Filename("..\Excel_Import\Room-Door Code\202308_DOOR CODE LIST.xlsx")  # graph input
filepath_data = Custom[FilePath Data](DefaulPath=choose_excel_file)  # package Data-Shapes; Create filepath input for UI.MultipleInputForm ++ . Check out www.data-shapes.net for more infos !
boolean = BoolSelector(true)
code_block_3 = CodeBlock { "Abort"; }
multipleinputform = Custom[MultipleInputForm ++](Description_optional=code_block, ButtonText_optional=code_block_2, Inputs=filepath_data, Toggle=boolean, CancelButtonText_optional=code_block_3)  # package Data-Shapes; Create a form with multiple inputs. see www.data-shapes.net for tutorials and infos!
code_block_4 = CodeBlock(x=multipleinputform.User_Inputs) { x[0]; }
categories = Categories("OST_Doors")
all_elements_of_category = ElementsOfCategory(Category=categories)

# group: Door operation code DICT
code_block_5 = CodeBlock { "Door Operation Code"; }
excel_import = Custom[© Excel.Import](filePath=code_block_4, sheetName=code_block_5)  # package Crumple; Imports a 2D matrix of data from an existing Excel file path from a given worksheet name. If a worksheet does not exist by that name it will take the data from the first worksheet instead. Credit to Cyril Poupin for most of the Python code (details in node body).
transpose = List.Transpose(lists=excel_import.dataRows)
ʳʰʸᵗʰᵐ_elements = Rhythm.Revit.Elements.Elements.GetParameterValueByNameTypeOrInstance(element=all_elements_of_category, parameterName=code_block_5)
is_not_empty_py = Python(IN[0]=ʳʰʸᵗʰᵐ_elements)  # IronPython2
# ---------- is_not_empty_py.python (6 lines) ----------
elements = IN[0]


new_list = [element.isalpha() or element.isdigit() for element in elements]

OUT = new_list
# ----------------------------------------
boolean_2 = BoolSelector(true)
allIndicesOf = List.AllIndicesOf(list=is_not_empty_py, item=boolean_2)
getItemAtIndex = List.GetItemAtIndex(list=all_elements_of_category, index=allIndicesOf)
code_block_6 = CodeBlock { "Door Operation"; }
getItemAtIndex_2 = List.GetItemAtIndex(list=ʳʰʸᵗʰᵐ_elements, index=allIndicesOf)

# group: see note
code_block_7 = CodeBlock { 0; }
# note: **only for reference on how did i come up for the "node to code" code block
getItemAtIndex_3 = List.GetItemAtIndex(list=transpose, index=code_block_7)
code_block_8 = CodeBlock { 1; }
getItemAtIndex_4 = List.GetItemAtIndex(list=transpose, index=code_block_8)

code_block_9 = CodeBlock(input=transpose) { code = List.GetItemAtIndex(input, 0); description = List.GetItemAtIndex(input, 1); }

# group (continued): Door operation code DICT
byKeysValues = DesignScript.Builtin.Dictionary.ByKeysValues(keys=code_block_9.code, values=code_block_9.description)
valueAtKey = DesignScript.Builtin.Dictionary.ValueAtKey(dictionary=byKeysValues, key=getItemAtIndex_2)
ʳʰʸᵗʰᵐ_elements_2 = Rhythm.Revit.Elements.Elements.SetParameterByNameTypeOrInstance(element=getItemAtIndex, parameterName=code_block_6, value=valueAtKey)
ʳʰʸᵗʰᵐ_elements_3 = Rhythm.Revit.Elements.Elements.GetParameterValueByNameTypeOrInstance(element=ʳʰʸᵗʰᵐ_elements_2, parameterName=code_block_6)
door_operation_result = Watch(ʳʰʸᵗʰᵐ_elements_3)  # graph output

# group: Door panel code DICT
code_block_10 = CodeBlock { "Door Panel Code"; }
ʳʰʸᵗʰᵐ_elements_4 = Rhythm.Revit.Elements.Elements.GetParameterValueByNameTypeOrInstance(element=all_elements_of_category, parameterName=code_block_10)
is_not_empty_py_2 = Python(IN[0]=ʳʰʸᵗʰᵐ_elements_4)  # IronPython2; same code as is_not_empty_py
boolean_3 = BoolSelector(true)
allIndicesOf_2 = List.AllIndicesOf(list=is_not_empty_py_2, item=boolean_3)
getItemAtIndex_5 = List.GetItemAtIndex(list=all_elements_of_category, index=allIndicesOf_2)
code_block_11 = CodeBlock { "Door Panel"; }
excel_import_2 = Custom[© Excel.Import](filePath=code_block_4, sheetName=code_block_10)
transpose_2 = List.Transpose(lists=excel_import_2.dataRows)
code_block_12 = CodeBlock(input=transpose_2) { code = List.GetItemAtIndex(input, 0); description = List.GetItemAtIndex(input, 1); }
byKeysValues_2 = DesignScript.Builtin.Dictionary.ByKeysValues(keys=code_block_12.code, values=code_block_12.description)
getItemAtIndex_6 = List.GetItemAtIndex(list=ʳʰʸᵗʰᵐ_elements_4, index=allIndicesOf_2)
valueAtKey_2 = DesignScript.Builtin.Dictionary.ValueAtKey(dictionary=byKeysValues_2, key=getItemAtIndex_6)
ʳʰʸᵗʰᵐ_elements_5 = Rhythm.Revit.Elements.Elements.SetParameterByNameTypeOrInstance(element=getItemAtIndex_5, parameterName=code_block_11, value=valueAtKey_2)
ʳʰʸᵗʰᵐ_elements_6 = Rhythm.Revit.Elements.Elements.GetParameterValueByNameTypeOrInstance(element=ʳʰʸᵗʰᵐ_elements_5, parameterName=code_block_11)
door_panel_result = Watch(ʳʰʸᵗʰᵐ_elements_6)  # graph output

# group: Door construction code DICT
code_block_13 = CodeBlock { "Door Construction Code"; }
ʳʰʸᵗʰᵐ_elements_7 = Rhythm.Revit.Elements.Elements.GetParameterValueByNameTypeOrInstance(element=all_elements_of_category, parameterName=code_block_13)
is_not_empty_py_3 = Python(IN[0]=ʳʰʸᵗʰᵐ_elements_7)  # IronPython2; same code as is_not_empty_py
boolean_4 = BoolSelector(true)
allIndicesOf_3 = List.AllIndicesOf(list=is_not_empty_py_3, item=boolean_4)
getItemAtIndex_7 = List.GetItemAtIndex(list=all_elements_of_category, index=allIndicesOf_3)
code_block_14 = CodeBlock { "Door Construction"; }
excel_import_3 = Custom[© Excel.Import](filePath=code_block_4, sheetName=code_block_13)
transpose_3 = List.Transpose(lists=excel_import_3.dataRows)
code_block_15 = CodeBlock(input=transpose_3) { code = List.GetItemAtIndex(input, 0); description = List.GetItemAtIndex(input, 1); }
byKeysValues_3 = DesignScript.Builtin.Dictionary.ByKeysValues(keys=code_block_15.code, values=code_block_15.description)
getItemAtIndex_8 = List.GetItemAtIndex(list=ʳʰʸᵗʰᵐ_elements_7, index=allIndicesOf_3)
valueAtKey_3 = DesignScript.Builtin.Dictionary.ValueAtKey(dictionary=byKeysValues_3, key=getItemAtIndex_8)
ʳʰʸᵗʰᵐ_elements_8 = Rhythm.Revit.Elements.Elements.SetParameterByNameTypeOrInstance(element=getItemAtIndex_7, parameterName=code_block_14, value=valueAtKey_3)
ʳʰʸᵗʰᵐ_elements_9 = Rhythm.Revit.Elements.Elements.GetParameterValueByNameTypeOrInstance(element=ʳʰʸᵗʰᵐ_elements_8, parameterName=code_block_14)
door_construction_result = Watch(ʳʰʸᵗʰᵐ_elements_9)  # graph output

# group: Door lock function code DICT
code_block_16 = CodeBlock { "Door Lock Function Code"; }
ʳʰʸᵗʰᵐ_elements_10 = Rhythm.Revit.Elements.Elements.GetParameterValueByNameTypeOrInstance(element=all_elements_of_category, parameterName=code_block_16)
is_not_empty_py_4 = Python(IN[0]=ʳʰʸᵗʰᵐ_elements_10)  # IronPython2; same code as is_not_empty_py
boolean_5 = BoolSelector(true)
allIndicesOf_4 = List.AllIndicesOf(list=is_not_empty_py_4, item=boolean_5)
getItemAtIndex_9 = List.GetItemAtIndex(list=all_elements_of_category, index=allIndicesOf_4)
code_block_17 = CodeBlock { "Door Lock Function"; }
excel_import_4 = Custom[© Excel.Import](filePath=code_block_4, sheetName=code_block_16)
transpose_4 = List.Transpose(lists=excel_import_4.dataRows)
code_block_18 = CodeBlock(input=transpose_4) { code = List.GetItemAtIndex(input, 0); description = List.GetItemAtIndex(input, 1); }
convert_to_string_py = Python(IN[0]=code_block_18.code)  # IronPython2
# ---------- convert_to_string_py.python (13 lines) ----------
list1 = IN[0]

new_list = []

for element in list1:
    n = str(element)
    if n.endswith('.0'):
        n = n[:-2]
        new_list.append(n)
    else:
        new_list.append(n)

OUT = new_list
# ----------------------------------------
byKeysValues_4 = DesignScript.Builtin.Dictionary.ByKeysValues(keys=convert_to_string_py, values=code_block_18.description)
getItemAtIndex_10 = List.GetItemAtIndex(list=ʳʰʸᵗʰᵐ_elements_10, index=allIndicesOf_4)
valueAtKey_4 = DesignScript.Builtin.Dictionary.ValueAtKey(dictionary=byKeysValues_4, key=getItemAtIndex_10)
ʳʰʸᵗʰᵐ_elements_11 = Rhythm.Revit.Elements.Elements.SetParameterByNameTypeOrInstance(element=getItemAtIndex_9, parameterName=code_block_17, value=valueAtKey_4)
ʳʰʸᵗʰᵐ_elements_12 = Rhythm.Revit.Elements.Elements.GetParameterValueByNameTypeOrInstance(element=ʳʰʸᵗʰᵐ_elements_11, parameterName=code_block_17)
door_lock_function_result = Watch(ʳʰʸᵗʰᵐ_elements_12)  # graph output

# group: Door Feature Code DICT
code_block_19 = CodeBlock { "Door Feature Code"; }
ʳʰʸᵗʰᵐ_elements_13 = Rhythm.Revit.Elements.Elements.GetParameterValueByNameTypeOrInstance(element=all_elements_of_category, parameterName=code_block_19)
get_index_py = Python(IN[0]=ʳʰʸᵗʰᵐ_elements_13)  # IronPython2
# ---------- get_index_py.python (9 lines) ----------
lists = IN[0]

index_list = []

for index,char in enumerate(lists):
	if char != "":
		index_list.append(index)
		
OUT = index_list
# ----------------------------------------
getItemAtIndex_11 = List.GetItemAtIndex(list=all_elements_of_category, index=get_index_py)
code_block_20 = CodeBlock { "Door Feature"; }
code_block_21 = CodeBlock { ","; }
excel_import_5 = Custom[© Excel.Import](filePath=code_block_4, sheetName=code_block_19)
transpose_5 = List.Transpose(lists=excel_import_5.dataRows)
code_block_22 = CodeBlock(input=transpose_5) { code = List.GetItemAtIndex(input, 0); description = List.GetItemAtIndex(input, 1); }
byKeysValues_5 = DesignScript.Builtin.Dictionary.ByKeysValues(keys=code_block_22.code, values=code_block_22.description)
with_value_py = Python(IN[0]=ʳʰʸᵗʰᵐ_elements_13)  # IronPython2
# ---------- with_value_py.python (20 lines) ----------
lists = IN[0]

empty_list = []
new_list = []
mod_list = []

for element in lists:
    if element == "":
        empty_list.append(element)
    else:
        new_list.append(element)
        
for element in new_list:
	if "." in element:
		n = element.replace(".", ",")
		mod_list.append(n)
	else:
		mod_list.append(element)

OUT = [mod_list, empty_list]
# ----------------------------------------
code_block_23 = CodeBlock { 0; }
getItemAtIndex_12 = List.GetItemAtIndex(list=with_value_py, index=code_block_23)
string = StringInput(",")
split = String.Split(string=getItemAtIndex_12, separator0=string)
flatten = List.Flatten(list=split)
replace_8_py = Python(IN[0]=flatten)  # IronPython2
# ---------- replace_8_py.python (6 lines) ----------
elements = IN[0]


new_list = [element.replace(" 8", "n8") for element in elements]

OUT = new_list
# ----------------------------------------
string_strip_py = Python(IN[0]=replace_8_py)  # IronPython2
# ---------- string_strip_py.python (5 lines) ----------
strings = IN[0]

new_string = [string.strip() for string in strings]

OUT = new_string
# ----------------------------------------
replace_py = Python(IN[0]=string_strip_py)  # IronPython2
# ---------- replace_py.python (6 lines) ----------
elements = IN[0]


new_list = [element.replace("--", "-") or element.replace(" ", "-") for element in elements]

OUT = new_list
# ----------------------------------------
valueAtKey_5 = DesignScript.Builtin.Dictionary.ValueAtKey(dictionary=byKeysValues_5, key=replace_py)
none_null_py = Python(IN[0]=valueAtKey_5)  # IronPython2
# ---------- none_null_py.python (9 lines) ----------
element_list = IN[0]
mod_list = []

for element in element_list:
    if element == "(none)":
        element = None
    mod_list.append(element)

OUT = mod_list
# ----------------------------------------
get_length_of_sublist_py = Python(IN[0]=getItemAtIndex_12)  # IronPython2
# ---------- get_length_of_sublist_py.python (9 lines) ----------
list = IN[0]

new_list = []

for x in list:
    xs = x.split(",")
    new_list.append(len(xs))

OUT = new_list
# ----------------------------------------
chop = List.Chop(list=none_null_py, lengths=get_length_of_sublist_py)
join = String.Join(separator=code_block_21, string0=chop)
flatten_2 = List.Flatten(list=join)
ʳʰʸᵗʰᵐ_elements_14 = Rhythm.Revit.Elements.Elements.SetParameterByNameTypeOrInstance(element=getItemAtIndex_11, parameterName=code_block_20, value=flatten_2)
ʳʰʸᵗʰᵐ_elements_15 = Rhythm.Revit.Elements.Elements.GetParameterValueByNameTypeOrInstance(element=ʳʰʸᵗʰᵐ_elements_14, parameterName=code_block_20)
door_feature_result = Watch(ʳʰʸᵗʰᵐ_elements_15)  # graph output

# group: Door Protection Pull or Wall Code DICT
code_block_24 = CodeBlock { "Door Protection Pull or Wall Code"; }
ʳʰʸᵗʰᵐ_elements_16 = Rhythm.Revit.Elements.Elements.GetParameterValueByNameTypeOrInstance(element=all_elements_of_category, parameterName=code_block_24)
is_not_empty_py_5 = Python(IN[0]=ʳʰʸᵗʰᵐ_elements_16)  # IronPython2; same code as is_not_empty_py
boolean_6 = BoolSelector(true)
allIndicesOf_5 = List.AllIndicesOf(list=is_not_empty_py_5, item=boolean_6)
getItemAtIndex_13 = List.GetItemAtIndex(list=all_elements_of_category, index=allIndicesOf_5)
code_block_25 = CodeBlock { "Door Protection Pull or Wall"; }
code_block_26 = CodeBlock { "Door Protection"; }
excel_import_6 = Custom[© Excel.Import](filePath=code_block_4, sheetName=code_block_26)
transpose_6 = List.Transpose(lists=excel_import_6.dataRows)
code_block_27 = CodeBlock(input=transpose_6) { code = List.GetItemAtIndex(input, 0); description = List.GetItemAtIndex(input, 1); }
byKeysValues_6 = DesignScript.Builtin.Dictionary.ByKeysValues(keys=code_block_27.code, values=code_block_27.description)
getItemAtIndex_14 = List.GetItemAtIndex(list=ʳʰʸᵗʰᵐ_elements_16, index=allIndicesOf_5)
valueAtKey_6 = DesignScript.Builtin.Dictionary.ValueAtKey(dictionary=byKeysValues_6, key=getItemAtIndex_14)
ʳʰʸᵗʰᵐ_elements_17 = Rhythm.Revit.Elements.Elements.SetParameterByNameTypeOrInstance(element=getItemAtIndex_13, parameterName=code_block_25, value=valueAtKey_6)
ʳʰʸᵗʰᵐ_elements_18 = Rhythm.Revit.Elements.Elements.GetParameterValueByNameTypeOrInstance(element=ʳʰʸᵗʰᵐ_elements_17, parameterName=code_block_25)
door_lock_function_result_2 = Watch(ʳʰʸᵗʰᵐ_elements_18)  # graph output

# group: Door Protection Pull or Wall Height DICT
code_block_28 = CodeBlock { "Door Protection Pull or Wall Height Code"; }
ʳʰʸᵗʰᵐ_elements_19 = Rhythm.Revit.Elements.Elements.GetParameterValueByNameTypeOrInstance(element=all_elements_of_category, parameterName=code_block_28)
is_not_empty_py_6 = Python(IN[0]=ʳʰʸᵗʰᵐ_elements_19)  # IronPython2; same code as is_not_empty_py
boolean_7 = BoolSelector(true)
allIndicesOf_6 = List.AllIndicesOf(list=is_not_empty_py_6, item=boolean_7)
getItemAtIndex_15 = List.GetItemAtIndex(list=all_elements_of_category, index=allIndicesOf_6)
code_block_29 = CodeBlock { "Door Protection Pull or Wall Height Text"; }
code_block_30 = CodeBlock { "Door Protection Height"; }
excel_import_7 = Custom[© Excel.Import](filePath=code_block_4, sheetName=code_block_30)
transpose_7 = List.Transpose(lists=excel_import_7.dataRows)
code_block_31 = CodeBlock(input=transpose_7) { code = List.GetItemAtIndex(input, 0); description = List.GetItemAtIndex(input, 1); }
convert_to_string_py_2 = Python(IN[0]=code_block_31.code)  # IronPython2; same code as convert_to_string_py
byKeysValues_7 = DesignScript.Builtin.Dictionary.ByKeysValues(keys=convert_to_string_py_2, values=code_block_31.description)
getItemAtIndex_16 = List.GetItemAtIndex(list=ʳʰʸᵗʰᵐ_elements_19, index=allIndicesOf_6)
valueAtKey_7 = DesignScript.Builtin.Dictionary.ValueAtKey(dictionary=byKeysValues_7, key=getItemAtIndex_16)
ʳʰʸᵗʰᵐ_elements_20 = Rhythm.Revit.Elements.Elements.SetParameterByNameTypeOrInstance(element=getItemAtIndex_15, parameterName=code_block_29, value=valueAtKey_7)
ʳʰʸᵗʰᵐ_elements_21 = Rhythm.Revit.Elements.Elements.GetParameterValueByNameTypeOrInstance(element=ʳʰʸᵗʰᵐ_elements_20, parameterName=code_block_29)
door_lock_function_result_3 = Watch(ʳʰʸᵗʰᵐ_elements_21)  # graph output

# group: Door Protection Push or Track Code DICT
code_block_32 = CodeBlock { "Door Protection Push or Track Code"; }
ʳʰʸᵗʰᵐ_elements_22 = Rhythm.Revit.Elements.Elements.GetParameterValueByNameTypeOrInstance(element=all_elements_of_category, parameterName=code_block_32)
is_not_empty_py_7 = Python(IN[0]=ʳʰʸᵗʰᵐ_elements_22)  # IronPython2; same code as is_not_empty_py
boolean_8 = BoolSelector(true)
allIndicesOf_7 = List.AllIndicesOf(list=is_not_empty_py_7, item=boolean_8)
getItemAtIndex_17 = List.GetItemAtIndex(list=all_elements_of_category, index=allIndicesOf_7)
code_block_33 = CodeBlock { "Door Protection Push or Track"; }
code_block_34 = CodeBlock { "Door Protection"; }
excel_import_8 = Custom[© Excel.Import](filePath=code_block_4, sheetName=code_block_34)
transpose_8 = List.Transpose(lists=excel_import_8.dataRows)
code_block_35 = CodeBlock(input=transpose_8) { code = List.GetItemAtIndex(input, 0); description = List.GetItemAtIndex(input, 1); }
byKeysValues_8 = DesignScript.Builtin.Dictionary.ByKeysValues(keys=code_block_35.code, values=code_block_35.description)
getItemAtIndex_18 = List.GetItemAtIndex(list=ʳʰʸᵗʰᵐ_elements_22, index=allIndicesOf_7)
valueAtKey_8 = DesignScript.Builtin.Dictionary.ValueAtKey(dictionary=byKeysValues_8, key=getItemAtIndex_18)
ʳʰʸᵗʰᵐ_elements_23 = Rhythm.Revit.Elements.Elements.SetParameterByNameTypeOrInstance(element=getItemAtIndex_17, parameterName=code_block_33, value=valueAtKey_8)
ʳʰʸᵗʰᵐ_elements_24 = Rhythm.Revit.Elements.Elements.GetParameterValueByNameTypeOrInstance(element=ʳʰʸᵗʰᵐ_elements_23, parameterName=code_block_33)
door_lock_function_result_4 = Watch(ʳʰʸᵗʰᵐ_elements_24)  # graph output

# group: Door Protection Push or Track Height DICT
code_block_36 = CodeBlock { "Door Protection Push or Track Height Code"; }
ʳʰʸᵗʰᵐ_elements_25 = Rhythm.Revit.Elements.Elements.GetParameterValueByNameTypeOrInstance(element=all_elements_of_category, parameterName=code_block_36)
is_not_empty_py_8 = Python(IN[0]=ʳʰʸᵗʰᵐ_elements_25)  # IronPython2; same code as is_not_empty_py
boolean_9 = BoolSelector(true)
allIndicesOf_8 = List.AllIndicesOf(list=is_not_empty_py_8, item=boolean_9)
getItemAtIndex_19 = List.GetItemAtIndex(list=all_elements_of_category, index=allIndicesOf_8)
code_block_37 = CodeBlock { "Door Protection Push or Track Height Text"; }
code_block_38 = CodeBlock { "Door Protection Height"; }
excel_import_9 = Custom[© Excel.Import](filePath=code_block_4, sheetName=code_block_38)
transpose_9 = List.Transpose(lists=excel_import_9.dataRows)
code_block_39 = CodeBlock(input=transpose_9) { code = List.GetItemAtIndex(input, 0); description = List.GetItemAtIndex(input, 1); }
convert_to_string_py_3 = Python(IN[0]=code_block_39.code)  # IronPython2; same code as convert_to_string_py
byKeysValues_9 = DesignScript.Builtin.Dictionary.ByKeysValues(keys=convert_to_string_py_3, values=code_block_39.description)
getItemAtIndex_20 = List.GetItemAtIndex(list=ʳʰʸᵗʰᵐ_elements_25, index=allIndicesOf_8)
valueAtKey_9 = DesignScript.Builtin.Dictionary.ValueAtKey(dictionary=byKeysValues_9, key=getItemAtIndex_20)
ʳʰʸᵗʰᵐ_elements_26 = Rhythm.Revit.Elements.Elements.SetParameterByNameTypeOrInstance(element=getItemAtIndex_19, parameterName=code_block_37, value=valueAtKey_9)
ʳʰʸᵗʰᵐ_elements_27 = Rhythm.Revit.Elements.Elements.GetParameterValueByNameTypeOrInstance(element=ʳʰʸᵗʰᵐ_elements_26, parameterName=code_block_37)
door_lock_function_result_5 = Watch(ʳʰʸᵗʰᵐ_elements_27)  # graph output
