# Dynamo graph script.dyn (Dynamo 2.12.1.8246)
# packages: Rhythm 2022.11.4, Data-Shapes 2022.2.106

# group: select room
code_block = CodeBlock { "Select Room"; }
categories = Categories("OST_Rooms")
boolean = BoolSelector(true)
selectmodelelements_data = Custom[SelectModelElements Data](ButtonText=code_block, CategoryFilter=categories, SelectSingleElement=boolean)  # package Data-Shapes; Creates a Revit element selection input for UI.MultipleInputForm++ . Check out www.data-shapes.net for more infos!

# group: input
code_block_2 = CodeBlock { "Room Door Mark"; "Room Door Clear Heights"; "Room Door Clear Widths"; }
code_block_3 = CodeBlock { 100; }
multilinetextbox_data = Custom[MultiLineTextBox Data](InputName=code_block_2.out0, Height_Optionnal=code_block_3)  # package Data-Shapes; Creates a multi line textbox input for UI.MultipleInputForm ++
multilinetextbox_data_2 = Custom[MultiLineTextBox Data](InputName=code_block_2.out1, Height_Optionnal=code_block_3)
multilinetextbox_data_3 = Custom[MultiLineTextBox Data](InputName=code_block_2.out2, Height_Optionnal=code_block_3)

list_create = List.Create(item0=selectmodelelements_data, item1=multilinetextbox_data, item2=multilinetextbox_data_2, item3=multilinetextbox_data_3)

# group: main UI
code_block_4 = CodeBlock { "Overwrite Texts"; }
file_path = Filename("..\..\Downloads\pngwing.com.png")
code_block_5 = CodeBlock { "Execute"; }
boolean_2 = BoolSelector(true)
code_block_6 = CodeBlock { "Abort"; }
code_block_7 = CodeBlock { 500; 170; }
multipleinputform = Custom[MultipleInputForm ++](Description_optional=code_block_4, Logo_optional=file_path, ButtonText_optional=code_block_5, Inputs=list_create, Toggle=boolean_2, CancelButtonText_optional=code_block_6, Width_optional=code_block_7.out0, LabelWidth_optional=code_block_7.out1)  # package Data-Shapes; Create a form with multiple inputs. see www.data-shapes.net for tutorials and infos!

code_block_8 = CodeBlock(x=multipleinputform.User_Inputs) { x[0]; }
string = StringInput("Room Door Marks")
getParameterValueByName = Element.GetParameterValueByName(element=code_block_8, parameterName=string)
string_2 = StringInput("Room Door Clear Heights")
getParameterValueByName_2 = Element.GetParameterValueByName(element=code_block_8, parameterName=string_2)
string_3 = StringInput("Room Door Clear Widths")
getParameterValueByName_3 = Element.GetParameterValueByName(element=code_block_8, parameterName=string_3)
code_block_9 = CodeBlock(x=multipleinputform.User_Inputs) { x[1]; x[2]; x[3]; }
ʳʰʸᵗʰᵐ_elements = Rhythm.Revit.Elements.Elements.SetParameterByNameTypeOrInstance(element=code_block_8, parameterName=string, value=code_block_9.out0)
ʳʰʸᵗʰᵐ_elements_2 = Rhythm.Revit.Elements.Elements.SetParameterByNameTypeOrInstance(element=code_block_8, parameterName=string_2, value=code_block_9.out1)
ʳʰʸᵗʰᵐ_elements_3 = Rhythm.Revit.Elements.Elements.SetParameterByNameTypeOrInstance(element=code_block_8, parameterName=string_3, value=code_block_9.out2)
